vi "PackageDetails.gviweb"   [LabVIEW NXG 4.0.0]
panel controls:
  "Download": bool
  "Version": i32
panel indicators:
  "URL Image": string
  "DisplayName": string
  "PkgIcon": string
  "ReleaseDate": string
  "Vendor": string
  "Author": string
  "Description": string
  "Release Notes": string
  "Dependencies": string
  "PrototypedBy": string
  "Name": string
types:
  "Package Version--cluster.gtype" = cluster{"ReleaseDate": string, "Version": string, "Name": string, "DisplayName": string, "Description": string, "Vendor": string, "Author": string, "Release Notes": string, "Dependencies": string[], "IconURL": string, "PackageURL": string, "RepoType": string, "RepoName": string}
  T1 = cluster{"BaseURL": string, "Package Details": "Package Version--cluster.gtype", "All Versions": string[]}
uses:
  QMH support::Message Queue::Create All Message Queues.gviweb
  HTTP Client API::Base URL--constant.gvi
  QMH support::Message Queue::Dequeue Message.gviweb
  QMH support::Message Queue::Enqueue Message (Single).gviweb
  HTTP Client API::Connection::Open Connection.gvi
  HTTP Client API::Packages::Get Package Details.gvi
  HTTP Client API::Packages::Get All Package Versions.gvi
  HTTP Client API::Connection::Close Connection.gvi
  WebApp::Support::JSON Timestamp to Display.gvi
  WebApp::Support::Join Strings.gvi
  RedirectURL::Redirect.jsli::Redirect
  HTTP Client API::Packages::Set Package.gvi
  NI::G Core::Error::Read Error Code.gvi
  Error Handling::Error Handler.gvi
  NI::G Core::Error::Build Error Cluster.gvi
  QMH support::Error Handler - Message Handling Loop.gviweb
  QMH support::Error Handler - Event Handling Loop.gviweb
diagram:
  w1 = bool TRUE  # Stop Event
  Create User Event[EventName="Stop Event"](user event data type=w1) -> (error out=w2, user event out=w3)
  call "Create All Message Queues.gviweb"(error in=w2) -> (message queues=w4, error out=w5)
  call "Base URL--constant.gvi"() -> (Base URL=w6)
  Property Node(instance in=T1 {all zero or empty}, "BaseURL"=w6) -> (instance out=w7)
  Property Node(instance in=w4) -> ("UI"=w8)
  s1 = w7  # shift register
  while {
    call "Dequeue Message.gviweb"(message queue in=w8, error in=w5) -> (message queue out=w9, message=w10, message data=w11, error out=w12)
    # s1: Data
    # w3: Stop Event
    case (w10) ignore case {  # Message Cases
      frame "Initialize" {
        call "Enqueue Message (Single).gviweb"(message queue in=w9, message="Get Package Details", error in=w12) -> (error out=w13)
        w14 = s1
        w15 = default
      }
      frame "Get Package Details" {
        Property Node(instance in=s1) -> ("BaseURL"=w16, instance out=w17)
        Set Busy(reference in=reference to unnamed front panel, error in=w12) -> (reference out=w18, error out=w19)
        call "Open Connection.gvi"(Root URL=w16, error in=w19) -> (Connection=w20, error out=w21)
        call "Get Package Details.gvi"(Connection in=w20, error in=w21) -> (Connection out=w22, Package Details=w23, error out=w24)
        call "Get All Package Versions.gvi"(Connection in=w22, error in=w24) -> (Connection out=w25, All Versions text=w26, error out=w27)
        Property Node(instance in=w17, "Package Details"=w23, "All Versions"=w26) -> (instance out=w14)
        call "Close Connection.gvi"(Connection in=w25, error in=w27) -> (error out=w28)
        Unset Busy(reference in=w18, error in=w28) -> (error out=w29)
        call "Enqueue Message (Single).gviweb"(message queue in=w9, message="Display Package Details", error in=w29) -> (error out=w13)
        w15 = default
      }
      frame "Display Package Details" {
        Property Node(instance in=s1) -> ("Package Details"=w30, instance out=w14)
        Property Node(instance in=w30) -> ("Name"=w31, "DisplayName"=w32, "IconURL"=w33, "ReleaseDate"=w34, "Vendor"=w35, "Author"=w36, "Description"=w37, "Release Notes"=w38, "Dependencies"=w39)
        $Name <- w31
        $DisplayName <- w32
        $PkgIcon <- w33
        call "JSON Timestamp to Display.gvi"(JSON Timestamp=w34) -> (Display Timestamp=w40)
        $ReleaseDate <- w40
        $Vendor <- w35
        $Author <- w36
        $Description <- w37
        $"Release Notes" <- w38
        call "Join Strings.gvi"(String Array Input=w39, Separator="\r\n") -> (String output=w41)
        $Dependencies <- w41
        call "Enqueue Message (Single).gviweb"(message queue in=w9, message="Display Versions", error in=w12) -> (error out=w13)
        w15 = default
      }
      frame "Display Versions" {
        Property Node(instance in=s1) -> ("All Versions"=w42, "Package Details:Version"=w43, instance out=w14)
        Search 1D Array(1D array=w42, element=w43) -> (index of element=w44)
        Property Node(instance in=reference to "Version", "Items"=w42, "Value"=w44)
        w13 = w12
        w15 = default
      }
      frame "Version changed" {
        Set Busy(reference in=reference to unnamed front panel, error in=w12) -> (reference out=w45, error out=w46)
        Property Node(instance in=s1) -> ("BaseURL"=w47, "Package Details:Name"=w48, "All Versions"=w49, instance out=w14)
        Decimal String To Number(string=w11) -> (number=w50)
        Array Index(array=w49) -> (out0[w50]=w51)
        Format Into String(formatString="%sPackage?Name=%s&Version=%s", w47, w48, w51) -> w52
        disable {
          frame Enabled {
            call "Redirect"(URL=w52, target="_parent", error in=w46) -> (error out=w53)
          }
          frame Disabled {
            call "Open Connection.gvi"(Root URL=w47, error in=w46) -> (Connection=w54, error out=w55)
            call "Set Package.gvi"(Connection in=w54, Name=w48, Version=w51, error in=w55) -> (Connection out=w56, error out=w57)
            call "Close Connection.gvi"(Connection in=w56, error in=w57) -> (error out=w58)
            call "Enqueue Message (Single).gviweb"(message queue in=w9, message="Get Package Details", error in=w58) -> (error out=w53)
          }
        }
        Unset Busy(reference in=w45, error in=w53) -> (error out=w13)
        w15 = default
      }
      frame "Download Package" {
        Set Busy(reference in=reference to unnamed front panel, error in=w12) -> (reference out=w59, error out=w60)
        Property Node(instance in=s1) -> ("Package Details:PackageURL"=w61, instance out=w14)
        call "Redirect"(URL=w61, target="_blank", error in=w60) -> (error out=w62)
        Unset Busy(reference in=w59, error in=w62) -> (error out=w13)
        w15 = default
      }
      frame "Error" {
        # Process Error
        w63 = no error  # Error
        Unflatten From JSON(JSON string=w11, error in (no error)=w12, type and defaults=w63) -> (error out=w13, value=w64)
        call "Read Error Code.gvi"(error in=w64) -> (code=w65)
        case (w65) {
          frame 501401 {
            # Redirect to Login page
            call "Redirect"(URL="Login.html")
          }
          frame 0, Default {
            # Display Error
            call "Error Handler.gvi"(error in=w64)
          }
        }
        w14 = s1
        w15 = default
      }
      frame "---Copy This Frame---" {
        Merge Errors(w12) -> (error out=w13)
        w14 = s1
        w15 = default
      }
      frame "Exit" {
        # Release the message queue reference
        Release Queue(error in=w12, queue=w9) -> (error out=w66)
        Generate User Event(event data=TRUE, user event=w3) -> (error out=w67)
        Merge Errors(w67, w66) -> (error out=w13)
        # Stop the VI
        w14 = s1
        w15 = TRUE
      }
      frame Default {
        w68 = "The invalid message string \"%s\" was received in the Message Handling Loop."
        Format Into String(formatString=w68, w10) -> w69
        call "Build Error Cluster.gvi"(code=1, description=w69) -> (error out=w13)
        w14 = s1
        w15 = default
      }
    }
    call "Error Handler - Message Handling Loop.gviweb"(message queue in=w9, error in=w13) -> (dup error in=w70)
    next s1 = w14
    stop if w15
  }
  Register For Events("Stop Event"=w3) -> (event registration refnum out=w71)
  s2 = w71  # shift register
  while {
    event (dynamic events = s2) {
      on dynamic event 0 {
        # The Message Handling Loop processed an "Exit" message, which fired this event to stop the Event Handling Loop.
        w72 = TRUE
        w73 = no error
        w74 = w8
      }
      on "Download" Value changed {
        call "Enqueue Message (Single).gviweb"(message queue in=w8, message="Download Package") -> (message queue out=w74, error out=w73)
        w72 = default
      }
      on "Version" Value changed {
        Event Data() -> ("New Value"=w75)
        Number To Decimal String(number=w75) -> (decimal integer string=w76)
        call "Enqueue Message (Single).gviweb"(message queue in=w8, message="Version changed", message data=w76) -> (message queue out=w74)
        w72 = default
        w73 = default
      }
    }
    call "Error Handler - Event Handling Loop.gviweb"(message queue in=w74, error in=w73) -> (dup error in=w77)
    stop if w72
  }
  Unregister For Events(error in=w77, event registration refnum=s2) -> (error out=w78)
  Merge Errors(w78, w70) -> (error out=w79)
  Destroy User Event(error in=w79, user event=w3)
