vi "Packages.gviweb"   [LabVIEW NXG 4.0.0]
# This template is for the Queued Message Handler design pattern. The Event Handling Loop generates messages based on user interface actions. The Message Handling Loop processes messages generated by the Event Handling Loop, or by other messages. The messages are string values, so new messages can be added easily to the Message Cases case structure in the Message Handling Loop. Each message cluster can also provide an optional value for Message Data,  which is a String that can be swapped to whatever type of data is required.
panel controls:
  "Search": string
  "First": bool
  "Previous": bool
  "Next": bool
  "Last": bool
  "Package Details": bool
  "Repo Type": i32[]
  "Repo Name": i32[]
panel indicators:
  "Tree": T1[]
  "Status string": string
  "URL Image": string
  "PrototypedBy": string
types:
  T1 = cluster{"Element 0": string, "Data": string, "Data_2": string}
  "List Packages Settings--cluster.gtype" = cluster{"PageNumber": i32, "SearchCriteria": string, "Filters": "Package Filters.gtype"}
  "List Details--cluster.gtype" = cluster{"TotalPackages": i32, "TotalPages": i32, "PagesBefore": i32, "PagesAfter": i32, "ItemsPerPage": i32}
  "Package--cluster.gtype" = cluster{"Name": string, "DisplayName": string, "RepoType": string, "RepoName": string, "Versions": "Package Version--cluster.gtype"[]}
  T2 = cluster{"BaseURL": string, "Settings": "List Packages Settings--cluster.gtype", "List Details": "List Details--cluster.gtype", "Packages": "Package--cluster.gtype"[], "All Tags": string[]}
uses:
  QMH support::Message Queue::Create All Message Queues.gviweb
  HTTP Client API::Base URL--constant.gvi
  QMH support::Message Queue::Dequeue Message.gviweb
  QMH support::Message Queue::Enqueue Message (Single).gviweb
  BusyStateAPI::Set Busy.gviweb
  HTTP Client API::Connection::Open Connection.gvi
  HTTP Client API::Packages::List Packages.gvi
  HTTP Client API::Connection::Close Connection.gvi
  BusyStateAPI::Unset Busy.gviweb
  WebApp::Support::Format Packages for Tree Display.gvi
  HTTP Client API::Packages::Get Package Filters.gvi
  WebApp::Support::Build Status String.gvi
  RedirectURL::Redirect.jsli::Redirect
  NI::G Core::Error::Read Error Code.gvi
  Error Handling::Error Handler.gvi
  NI::G Core::Error::Build Error Cluster.gvi
  QMH support::Error Handler - Message Handling Loop.gviweb
  QMH support::Error Handler - Event Handling Loop.gviweb
diagram:
  w1 = bool TRUE  # Stop Event
  Create User Event[EventName="Stop Event"](user event data type=w1) -> (error out=w2, user event out=w3)
  call "Create All Message Queues.gviweb"(error in=w2) -> (message queues=w4, error out=w5)
  call "Base URL--constant.gvi"() -> (Base URL=w6)
  w7 = T2 {"BaseURL"="", "Settings"={"PageNumber"=1, "SearchCriteria"="", "Filters"={"RepoTypes"=[], "RepoNames"=[]}}, "List Details"={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}, "Packages"=[], "All Tags"=[]}
  Property Node(instance in=w7, "BaseURL"=w6) -> (instance out=w8)
  Property Node(instance in=w4) -> ("UI"=w9)
  s1 = w8  # shift register
  while {
    call "Dequeue Message.gviweb"(message queue in=w9, error in=w5) -> (message queue out=w10, message=w11, message data=w12, error out=w13)
    # s1: Data
    # w3: Stop Event
    case (w11) ignore case {  # Message Cases
      frame "Initialize" {
        Property Node(instance in=s1, "Settings:PageNumber"=1) -> (instance out=w15)
        Property Node(instance in=reference to "Tree", "ColumnHeaders"=["Name", "Vendor", "Repository"])
        call "Enqueue Message (Single).gviweb"(message queue in=w10, message="Get Filters", error in=w13) -> (message queue out=w17, error out=w18)
        call "Enqueue Message (Single).gviweb"(message queue in=w17, message="List Packages", error in=w18) -> (error out=w14)
        w16 = default
      }
      frame "List Packages" {
        Property Node(instance in=s1) -> ("BaseURL"=w19, "Settings"=w20, instance out=w21)
        call "Set Busy.gviweb"(error in=w13) -> (error out=w22)
        call "Open Connection.gvi"(Root URL=w19, error in=w22) -> (Connection=w23, error out=w24)
        call "List Packages.gvi"(Connection in=w23, List Packages Settings=w20, error in=w24) -> (Connection out=w25, Packages=w26, List Details=w27, error out=w28)
        Property Node(instance in=w21, "Packages"=w26, "List Details"=w27) -> (instance out=w15)
        call "Close Connection.gvi"(Connection in=w25, error in=w28) -> (error out=w29)
        call "Unset Busy.gviweb"(error in=w29) -> (error out=w30)
        call "Enqueue Message (Single).gviweb"(message queue in=w10, message="Display Packages List", error in=w30) -> (error out=w14)
        w16 = default
      }
      frame "Display Packages List" {
        Property Node(instance in=s1) -> ("Packages"=w31, instance out=w32)
        call "Set Busy.gviweb"(error in=w13) -> (error out=w33)
        call "Format Packages for Tree Display.gvi"(Packages=w31, error in=w33) -> (Packages Tree=w34, All Tags=w35, error out=w36)
        $Tree <- w34
        Property Node(instance in=w32, "All Tags"=w35) -> (instance out=w15)
        call "Unset Busy.gviweb"(error in=w36) -> (error out=w37)
        call "Enqueue Message (Single).gviweb"(message queue in=w10, message="Refresh Controls", error in=w37) -> (error out=w14)
        # Force reset scroll position
        Array Index(array=w35) -> (out0[0]=w38)
        Open Tree Item(reference in=reference to "Tree", location=w38) -> (reference out=w39)
        Close Tree Item(reference in=w39, location=w38)
        w16 = default
      }
      frame "Get Filters" {
        Property Node(instance in=s1) -> ("BaseURL"=w40, instance out=w41)
        call "Set Busy.gviweb"(error in=w13) -> (error out=w42)
        call "Open Connection.gvi"(Root URL=w40, error in=w42) -> (Connection=w43, error out=w44)
        call "Get Package Filters.gvi"(Connection in=w43, error in=w44) -> (Connection out=w45, Filters=w46, error out=w47)
        Property Node(instance in=w46) -> ("RepoTypes"=w48, "RepoNames"=w49)
        Array Index(array=w48) -> (out0[_]=w50)
        Build Array(w50) -> w51
        Array Index(array=w49) -> (out0[_]=w52)
        Build Array(w52) -> w53
        Property Node(instance in=w41, "Settings:Filters:RepoTypes"=w51, "Settings:Filters:RepoNames"=w53) -> (instance out=w15)
        Property Node(instance in=reference to "Repo Type", "Items"=w48, "Value"=[0])
        Property Node(instance in=reference to "Repo Name", "Items"=w49, "Value"=[0])
        call "Close Connection.gvi"(Connection in=w45, error in=w47) -> (error out=w54)
        call "Unset Busy.gviweb"(error in=w54) -> (error out=w14)
        w16 = default
      }
      frame "Search value changed" {
        Property Node(instance in=s1) -> ("Settings"=w55, instance out=w56)
        Property Node(instance in=w55, "SearchCriteria"=w12, "PageNumber"=1) -> (instance out=w57)
        Property Node(instance in=w56, "Settings"=w57) -> (instance out=w15)
        Flatten To JSON(anything=w57) -> (JSON string=w58)
        call "Enqueue Message (Single).gviweb"(message queue in=w10, message="List Packages", message data=w58, error in=w13) -> (error out=w14)
        w16 = default
      }
      frame "Tree Selection Changed" {
        call "Enqueue Message (Single).gviweb"(message queue in=w10, message="Refresh Controls", error in=w13) -> (error out=w14)
        w15 = s1
        w16 = default
      }
      frame "Refresh Controls" {
        Build Array(reference to "First", reference to "Previous", reference to "Next", reference to "Last") -> w59
        Property Node(instance in=s1) -> ("List Details:PagesBefore"=w60, "List Details:PagesAfter"=w61, "Settings"=w62, "List Details"=w63, instance out=w15)
        Is Equal To 0(x=w60) -> w64
        case (w64) {
          frame False, Default {
            w65 = FALSE
            w66 = FALSE
          }
          frame True {
            w65 = TRUE
            w66 = TRUE
          }
        }
        Is Equal To 0(x=w61) -> w67
        case (w67) {
          frame False, Default {
            w68 = FALSE
            w69 = FALSE
          }
          frame True {
            w68 = TRUE
            w69 = TRUE
          }
        }
        Build Array(w65, w66, w68, w69) -> w70
        for {
          w71 = each element of w70
          w72 = each element of w59
          Property Node(instance in=w72, "Disabled"=w71)
        }
        call "Build Status String.gvi"(List Package settings=w62, List Details=w63) -> (Status String=w73)
        $"Status string" <- w73
        Property Node(instance in=reference to "Tree") -> ("SelectedData"=w74)
        Property Node(instance in=w74) -> ("Element 0"=w75)
        Is Empty String Or Path(string/path=w75) -> w76
        Property Node(instance in=reference to "Package Details", "Disabled"=w76)
        w14 = w13
        w16 = default
      }
      frame "Show Package Details" {
        call "Set Busy.gviweb"(error in=w13) -> (error out=w77)
        Property Node(instance in=s1) -> ("BaseURL"=w78, "Packages"=w79, "All Tags"=w80, instance out=w15)
        Property Node(instance in=reference to "Tree") -> ("SelectedData"=w81)
        Property Node(instance in=w81) -> ("Element 0"=w82)
        Search 1D Array(1D array=w80, element=w82) -> (index of element=w83)
        Array Index(array=w79) -> (out0[w83]=w84)
        Property Node(instance in=w84) -> ("Name"=w85)
        Concatenate Strings(w78, "Package?Name=", w85) -> w86
        call "Redirect"(URL=w86, target="_blank", error in=w77) -> (error out=w87)
        call "Unset Busy.gviweb"(error in=w87) -> (error out=w14)
        w16 = default
      }
      frame "Repo Type changed" {
        Unflatten From JSON(JSON string=w12, type and defaults=i32[] []) -> (value=w88)
        Is Empty Array(array=w88) -> w89
        case (w89) {
          frame False, Default {
            w90 = w88
          }
          frame True {
            w90 = [0]
          }
        }
        Property Node(instance in=reference to "Repo Type", "Value"=w90) -> ("Items"=w91)
        for {
          w92 = each element of w90
          Array Index(array=w91) -> (out0[w92]=w94)
          append w94 to w93
        }
        Property Node(instance in=s1, "Settings:Filters:RepoTypes"=w93) -> (instance out=w15)
        call "Enqueue Message (Single).gviweb"(message queue in=w10, message="List Packages", error in=w13) -> (error out=w14)
        w16 = default
      }
      frame "Repo Name changed" {
        Unflatten From JSON(JSON string=w12, type and defaults=i32[] []) -> (value=w95)
        Is Empty Array(array=w95) -> w96
        case (w96) {
          frame False, Default {
            w97 = w95
          }
          frame True {
            w97 = [0]
          }
        }
        Property Node(instance in=reference to "Repo Name", "Value"=w97) -> ("Items"=w98)
        for {
          w99 = each element of w97
          Array Index(array=w98) -> (out0[w99]=w101)
          append w101 to w100
        }
        Property Node(instance in=s1, "Settings:Filters:RepoNames"=w100) -> (instance out=w15)
        call "Enqueue Message (Single).gviweb"(message queue in=w10, message="List Packages", error in=w13) -> (error out=w14)
        w16 = default
      }
      frame "First" {
        Property Node(instance in=s1) -> ("Settings"=w102, instance out=w103)
        Property Node(instance in=w102, "PageNumber"=1) -> (instance out=w104)
        Property Node(instance in=w103, "Settings"=w104) -> (instance out=w15)
        Flatten To JSON(anything=w104) -> (JSON string=w105)
        call "Enqueue Message (Single).gviweb"(message queue in=w10, message="List Packages", message data=w105, error in=w13) -> (error out=w14)
        w16 = default
      }
      frame "Last" {
        Property Node(instance in=s1) -> ("Settings"=w106, "List Details:TotalPages"=w107, instance out=w108)
        Property Node(instance in=w106, "PageNumber"=w107) -> (instance out=w109)
        Property Node(instance in=w108, "Settings"=w109) -> (instance out=w15)
        Flatten To JSON(anything=w109) -> (JSON string=w110)
        call "Enqueue Message (Single).gviweb"(message queue in=w10, message="List Packages", message data=w110, error in=w13) -> (error out=w14)
        w16 = default
      }
      frame "Previous" {
        Property Node(instance in=s1) -> ("Settings"=w111, "Settings:PageNumber"=w112, instance out=w113)
        Decrement(x=w112) -> w114
        Property Node(instance in=w111, "PageNumber"=w114) -> (instance out=w115)
        Property Node(instance in=w113, "Settings"=w115) -> (instance out=w15)
        Flatten To JSON(anything=w115) -> (JSON string=w116)
        call "Enqueue Message (Single).gviweb"(message queue in=w10, message="List Packages", message data=w116, error in=w13) -> (error out=w14)
        w16 = default
      }
      frame "Next" {
        Property Node(instance in=s1) -> ("Settings"=w117, "Settings:PageNumber"=w118, instance out=w119)
        Increment(x=w118) -> w120
        Property Node(instance in=w117, "PageNumber"=w120) -> (instance out=w121)
        Property Node(instance in=w119, "Settings"=w121) -> (instance out=w15)
        Flatten To JSON(anything=w121) -> (JSON string=w122)
        call "Enqueue Message (Single).gviweb"(message queue in=w10, message="List Packages", message data=w122, error in=w13) -> (error out=w14)
        w16 = default
      }
      frame "Error" {
        # Process Error
        w123 = no error  # Error
        Unflatten From JSON(JSON string=w12, error in (no error)=w13, type and defaults=w123) -> (error out=w14, value=w124)
        call "Read Error Code.gvi"(error in=w124) -> (code=w125)
        case (w125) {
          frame 501401 {
            # Redirect to Login page
            call "Redirect"(URL="Login.html")
          }
          frame 0, Default {
            # Display Error
            call "Error Handler.gvi"(error in=w124)
          }
        }
        w15 = s1
        w16 = default
      }
      frame "---Copy This Frame---" {
        Merge Errors(w13) -> (error out=w14)
        w15 = s1
        w16 = default
      }
      frame "Exit" {
        # Release the message queue reference
        Release Queue(error in=w13, queue=w10) -> (error out=w126)
        Generate User Event(event data=TRUE, user event=w3) -> (error out=w127)
        Merge Errors(w127, w126) -> (error out=w14)
        # Stop the VI
        w15 = s1
        w16 = TRUE
      }
      frame Default {
        w128 = "The invalid message string \"%s\" was received in the Message Handling Loop."
        Format Into String(formatString=w128, w11) -> w129
        call "Build Error Cluster.gvi"(code=1, description=w129) -> (error out=w14)
        w15 = s1
        w16 = default
      }
    }
    call "Error Handler - Message Handling Loop.gviweb"(message queue in=w10, error in=w14) -> (dup error in=w130)
    next s1 = w15
    stop if w16
  }
  Register For Events("Stop Event"=w3) -> (event registration refnum out=w131)
  s2 = w131  # shift register
  while {
    event (dynamic events = s2) {
      on dynamic event 0 {
        # The Message Handling Loop processed an "Exit" message, which fired this event to stop the Event Handling Loop.
        w132 = TRUE
        w133 = no error
        w134 = w9
      }
      on "Tree" Selection changed {
        Event Data() -> ("NewSelection"=w135)
        call "Enqueue Message (Single).gviweb"(message queue in=w9, message="Tree Selection Changed", message data=w135) -> (message queue out=w134, error out=w133)
        w132 = default
      }
      on "Search" Value changed {
        Event Data() -> ("New Value"=w136)
        call "Enqueue Message (Single).gviweb"(message queue in=w9, message="Search value changed", message data=w136) -> (message queue out=w134, error out=w133)
        w132 = default
      }
      on "First" Value changed {
        call "Enqueue Message (Single).gviweb"(message queue in=w9, message="First") -> (message queue out=w134, error out=w133)
        w132 = default
      }
      on "Last" Value changed {
        call "Enqueue Message (Single).gviweb"(message queue in=w9, message="Last") -> (message queue out=w134, error out=w133)
        w132 = default
      }
      on "Next" Value changed {
        call "Enqueue Message (Single).gviweb"(message queue in=w9, message="Next") -> (message queue out=w134, error out=w133)
        w132 = default
      }
      on "Previous" Value changed {
        call "Enqueue Message (Single).gviweb"(message queue in=w9, message="Previous") -> (message queue out=w134, error out=w133)
        w132 = default
      }
      on "Package Details" Value changed {
        call "Enqueue Message (Single).gviweb"(message queue in=w9, message="Show Package Details") -> (message queue out=w134, error out=w133)
        w132 = default
      }
      on "Repo Type" Value changed {
        Event Data() -> ("Old Value"=w137, "New Value"=w138)
        Is Equal[ComparisonMode=CompareAggregates](x=w137, y=[0]) -> w139
        case (w139) {
          frame False, Default {
            Search 1D Array(1D array=w137, element=0) -> (index of element=w141)
            case (w141) {
              frame -1 {
                Search 1D Array(1D array=w138, element=0) -> (index of element=w142)
                Is Greater Or Equal To 0(x=w142) -> w143
                Select(s=w143, t=[0], f=w138) -> w140
              }
              frame Default {
                Delete From Array(inArray=w138, index0=w141) -> w140
              }
            }
          }
          frame True {
            Search 1D Array(1D array=w138, element=0) -> (index of element=w144)
            Delete From Array(inArray=w138, index0=w144) -> w140
          }
        }
        Flatten To JSON(anything=w140) -> (JSON string=w145)
        call "Enqueue Message (Single).gviweb"(message queue in=w9, message="Repo Type changed", message data=w145) -> (message queue out=w134)
        w132 = default
        w133 = default
      }
      on "Repo Name" Value changed {
        Event Data() -> ("Old Value"=w146, "New Value"=w147)
        Is Equal[ComparisonMode=CompareAggregates](x=w146, y=[0]) -> w148
        case (w148) {
          frame False, Default {
            Search 1D Array(1D array=w146, element=0) -> (index of element=w150)
            case (w150) {
              frame -1 {
                Search 1D Array(1D array=w147, element=0) -> (index of element=w151)
                Is Greater Or Equal To 0(x=w151) -> w152
                Select(s=w152, t=[0], f=w147) -> w149
              }
              frame Default {
                Delete From Array(inArray=w147, index0=w150) -> w149
              }
            }
          }
          frame True {
            Search 1D Array(1D array=w147, element=0) -> (index of element=w153)
            Delete From Array(inArray=w147, index0=w153) -> w149
          }
        }
        Flatten To JSON(anything=w149) -> (JSON string=w154)
        call "Enqueue Message (Single).gviweb"(message queue in=w9, message="Repo Name changed", message data=w154) -> (message queue out=w134)
        w132 = default
        w133 = default
      }
    }
    call "Error Handler - Event Handling Loop.gviweb"(message queue in=w134, error in=w133) -> (dup error in=w155)
    stop if w132
  }
  Unregister For Events(error in=w155, event registration refnum=s2) -> (error out=w156)
  Merge Errors(w156, w130) -> (error out=w157)
  Destroy User Event(error in=w157, user event=w3)
